# Grasshopper definition assignment-01.gh (Grasshopper 1.0.8)
# plug-ins: RhinoCodePluginGH

# ---- group: Grid
point = Point(Point(-4.273202757, -3.211116645, 0))
x_count = Slider(5, range=1..10)
y_count = Slider(1, range=1..10)
x_space = Slider(3, range=1..10)
y_space = Slider(4, range=1..10)

# ---- group: Auto-reloads cdf module on VScode changes
# Setting path for Src AutoReloader: 1. Right click on Path
# 2. Choose "Select a directory"
# 3. Locate the ..\cdf1_teaching\src folder in your computer
# NOTES:
# 
# - Use Python 3 Script blocks for your functions.
# - Import your functions and classes as: from cdf import my_function, My_class
# - Don't forget to add and name your INPUT and OUTPUT parameters that match your functions correctly. If you zoom in to the Python component you will see the + sign to add and - to remove them.
# - You need to attach the accurate components to your INPUT parameters: sliders for integers or floats, toggles or buttons for booleans, text for strings, Rhino geometries etc. etc.
# - If an INPUT is  a list, you need to right-click the parameter to set it as LIST access. Sometimes you need to also set the type of the INPUT by clicking TYPE HINT and selecting the correct input type.
# - If you want to hide an object, right-click component and uncheck Preview. To visualize again, check Preview.
# - If you get errors, READ THEM! They often tell what's wrong in a simple language. If not, copy-paste to CoPilot and don't be afraid to play around!
# 
# For more Grasshopper Help, go to:
# https://developer.rhino3d.com/guides/scripting/scripting-component/#script-inputs-and-outputs
# Assignment-01: Bauhaus
path = FilePath("/Users/moritzmacbookpro/Documents/GitHub/cdf1_teaching/src/")
autoreloader = Python3Script(src_path=path)  # -> out; inputs src_path: String
# ---------- autoreloader: Python ----------
#! python3
import sys, os, time
import scriptcontext as sc
import Rhino, System
from System.IO import FileSystemWatcher, NotifyFilters

VERSION = 1  
pkg = "cdf"

if not src_path:
    raise Exception("Connect a folder to src_path.")
path = os.path.normpath(src_path)
watch_dir = os.path.join(path, pkg)
if not os.path.isdir(watch_dir):
    raise Exception("No '{}' folder found in:\n{}".format(pkg, path))

def unload():
    for name in list(sys.modules):
        if name == pkg or name.startswith(pkg + "."):
            del sys.modules[name]

# Put this folder first in Python's search list
if path in sys.path:
    sys.path.remove(path)
sys.path.insert(0, path)

key = "cdf_watcher_" + str(ghenv.Component.InstanceGuid)
time_key = key + "_time"
version_key = key + "_version"

def stamp():
    sc.sticky[time_key] = time.strftime("%Y-%m-%d %H:%M:%S")

# Replace the old watcher if the folder changed or the script was updated
old = sc.sticky.get(key)
if old is not None and (os.path.normpath(old.Path) != watch_dir
                        or sc.sticky.get(version_key) != VERSION):
    old.Dispose()
    del sc.sticky[key]
    unload()

if key not in sc.sticky:
    comp = ghenv.Component
    last = [0.0]

    def reload_and_rerun():
        unload()
        stamp()
        doc = comp.OnPingDocument()
        if doc is None:            # reloader was deleted or the file closed
            return
        for obj in doc.Objects:
            if "Python" in obj.GetType().Name:
                obj.ExpireSolution(False)   # mark as out of date
        doc.NewSolution(False)              # recompute once

    def on_change(sender, e):
        if not e.FullPath.endswith(".py") or "__pycache__" in e.FullPath:
            return
        if time.time() - last[0] < 0.5:     # ignore the second event of a double save
            return
        last[0] = time.time()
        Rhino.RhinoApp.InvokeOnUiThread(System.Action(reload_and_rerun))

    w = FileSystemWatcher(watch_dir, "*.py")
    w.IncludeSubdirectories = True
    w.NotifyFilter = NotifyFilters.LastWrite
    w.Changed += on_change
    w.EnableRaisingEvents = True
    sc.sticky[key] = w
    sc.sticky[version_key] = VERSION
    stamp()                                  # time the watcher started

msg = "Last reloaded: {}\nWatching: {}".format(sc.sticky.get(time_key, "unknown"), watch_dir)
print(msg)
out = msg
# ---------- end autoreloader ----------
panel = Panel(autoreloader)

# ---- group: Grid
centers = Python3Script(pt=point, x1=x_count, y1=y_count, x2=x_space, y2=x_space)  # -> out, a
# ---------- centers: Python ----------
# Import function
from cdf import create_grid_centers

# Call function
my_centers = create_grid_centers(
    base_point=pt,
    x_count=x1,
    y_count=y1,
    x_spacing=x2,
    y_spacing=y2
)

# Assign the output
a = my_centers
# ---------- end centers ----------
my_grid = Python3Script(pt=point, x=x_count, y=y_count, x1=x_space, y1=x_space)  # -> out, a
# ---------- my_grid: Python ----------
# Import function
from cdf import create_grid

# Call function
my_grid = create_grid(
    base_point=pt,
    x_count=x,
    y_count=y,
    x_spacing=x1,
    y_spacing=y1)

# Assign the output
a = my_grid
# ---------- end my_grid ----------

# ---- group: random center points
number_slider = Slider(1, range=0.1..1)
number_slider_2 = Slider(44, range=0..100)

# ----
expression = Expression(x=x_space, Expression="x/2")

# ---- group: random center points
random_centers = Python3Script(grid_centers=centers.a, density=number_slider, seed=number_slider_2)  # -> out, a; inputs grid_centers: list
# ---------- random_centers: Python ----------
from cdf import select_random_grid_centers

selected_centers = select_random_grid_centers(
    grid_centers=grid_centers,
    density=density,
    seed=seed
)

a = selected_centers
# ---------- end random_centers ----------

# ---- group: Geometries
number_slider_3 = Slider(1.351, range=0..3)
number_slider_4 = Slider(2.3, range=0..10)
cylinder = Python3Script(h=number_slider_4, r=expression)  # -> out, a
# ---------- cylinder: Python ----------
# Import function
from cdf import create_cylinder

# Call function
my_cylinder = create_cylinder(
    base_point=pt,
    height=h,
    radius=r,
    cap=True
)

# Assign the output
a = my_cylinder
# ---------- end cylinder ----------
torus = Python3Script(maj_r=expression, min_r=Slider(1.153, range=0..3))  # -> out, a
# ---------- torus: Python ----------
# Import function
from cdf import create_torus

# Call function
my_torus = create_torus(
    base_point=pt,
    major_radius=maj_r,
    minor_radius=min_r
)

# Assign the output
a = my_torus
# ---------- end torus ----------
expression_2 = Expression(x=number_slider_4, Expression="x/2")
move_brep = Python3Script(z=expression_2, brep=torus.a)  # -> out, a
# ---------- move_brep: Python ----------
# Import function
from cdf import move_brep

# Call function
my_moved_brep = move_brep(
    brep=brep,
    move_x=x,
    move_y=y,
    move_z=z
)

# Assign the output
a = my_moved_brep
# ---------- end move_brep ----------
boolean_difference = Python3Script(a=cylinder.a, b=move_brep.a)  # -> out, a
# ---------- boolean_difference: Python ----------
from cdf import boolean_difference

my_difference = boolean_difference(brep_a=a, brep_b=b)

a = my_difference
# ---------- end boolean_difference ----------

# ----
curve = Curve(my_grid.a)
pipe = Pipe(Curve=curve, Radius=Slider(0.038, range=0..0.9), Caps=0)

# ---- group: Geometries
cone = Python3Script(h=Slider(2, range=1..10), r=expression)  # -> out, my_cone; inputs pt: Point3d
# ---------- cone: Python ----------
# import function
from cdf import create_cone

# call function
my_cone = create_cone(base_point=pt, height=h, radius=r)
# ---------- end cone ----------

number_slider_5 = Slider(3, range=1..10)
cube = Python3Script(x=x_space, y=x_space, z=x_space)  # -> out, a
# ---------- cube: Python ----------
from cdf import create_cube_2

my_cube = create_cube_2(
    center_point=center,
    x_size=x,
    y_size=y,
    z_size=z
)

a = my_cube
# ---------- end cube ----------

sphere = Python3Script(r=expression)  # -> out, my_sphere; inputs pt: Point3d, r: Double
# ---------- sphere: Python ----------
from cdf import create_sphere

my_sphere = create_sphere(base_point=pt, radius=r)

a = my_sphere
# ---------- end sphere ----------

# ---- group: transformations & operations
rotate_brep = Python3Script(brep=cone.my_cone, x=Slider(180, range=0..180), y=Slider(0, range=0..180))  # -> out, a
# ---------- rotate_brep: Python ----------
# Import function
from cdf import rotate_brep

# Call function
my_rotated_brep = rotate_brep(
    brep=brep,
    angle_x=x,
    angle_y=y,
    center=c
)

# Assign the output
a = my_rotated_brep
# ---------- end rotate_brep ----------

# ---- group: weight
number_slider_6 = Slider(0.2, range=0..1)
number_slider_7 = Slider(0.2, range=0..1)
number_slider_8 = Slider(0.2, range=0..1)
number_slider_9 = Slider(0.2, range=0..1)
number_slider_10 = Slider(0.2, range=0..1)

# ---- group: transformations & operations
mirror = Python3Script(brep=rotate_brep.a)  # -> out, a
# ---------- mirror: Python ----------
from cdf import mirror_brep

my_mirrored_brep = mirror_brep(
    brep=brep
)

a = my_mirrored_brep
# ---------- end mirror ----------
brep = Brep(rotate_brep.a)
relay = Relay([brep, mirror.a])

# ---- group: Tube
number_slider_11 = Slider(1.299, range=0..10)
outer_cylinder = Python3Script(h=x_space, r=expression)  # -> out, a; same code as cylinder

# ----
limiter = Python3Script(outer_r=expression, inner_r=number_slider_11)  # -> out, a
# ---------- limiter: Python ----------
from cdf import limit_inner_radius

limited_inner_radius = limit_inner_radius(
    outer_radius=outer_r,
    inner_radius=inner_r
)

a = limited_inner_radius
# ---------- end limiter ----------

# ---- group: Tube (continued)
inner_cylinder = Python3Script(r=limiter.a)  # -> out, a; same code as cylinder
boolean_difference_2 = Python3Script(a=outer_cylinder.a, b=inner_cylinder.a)  # -> out, a; same code as boolean_difference

# ----
seed = Slider(65, range=0..100)
merge = Merge(Data1=sphere.my_sphere, Data2=cone.my_cone, Data3=cube.a, Data4=boolean_difference_2.a, Data5=boolean_difference.a)  # -> flatten(Result)
merge_2 = Merge(Data1=number_slider_9, Data2=number_slider_6, Data3=number_slider_7, Data4=number_slider_8, Data5=number_slider_10)
assign_brep_to_center_and_group = Python3Script(centers=random_centers.a, breps=merge, weights=merge_2, seed=seed)  # -> out, a, b, c, d, e; inputs centers: list, breps: list of Brep, weights: list of Double, seed: list of Int32
# ---------- assign_brep_to_center_and_group: Python ----------
from cdf import assign_breps_to_center_groups

groups = assign_breps_to_center_groups(
    centers=centers,
    brep_templates=breps,
    weights=weights,
    seed=seed
)

a = groups[0] if len(groups) > 0 else []
b = groups[1] if len(groups) > 1 else []
c = groups[2] if len(groups) > 2 else []
d = groups[3] if len(groups) > 3 else []
e = groups[4] if len(groups) > 4 else []
# ---------- end assign_brep_to_center_and_group ----------

# ---- group: Bauhaus Color Palett
preview = CustomPreview(Geometry=assign_brep_to_center_and_group.a, Material=ColourSwatch(SwatchColor=RGB(255, 0, 0)))
preview_2 = CustomPreview(Geometry=assign_brep_to_center_and_group.b, Material=ColourSwatch(SwatchColor=RGB(255, 255, 0)))
preview_3 = CustomPreview(Geometry=pipe, Material=ColourSwatch(SwatchColor=RGB(0, 0, 0)))
preview_4 = CustomPreview(Geometry=assign_brep_to_center_and_group.c, Material=ColourSwatch(SwatchColor=RGB(0, 0, 255)))
preview_5 = CustomPreview(Geometry=assign_brep_to_center_and_group.d, Material=ColourSwatch(SwatchColor=RGB(9, 140, 0)))
preview_6 = CustomPreview(Geometry=assign_brep_to_center_and_group.e, Material=ColourSwatch(SwatchColor=RGB(34, 158, 224)))
